# Grasshopper definition 1-Wavy Joint.gh (Grasshopper 1.0.7)

P = Plane(PlaneXY(0, 0, 0))
recgrid = Rectangular(
    Plane=P,
    SizeX=Slider(2, range=0..10),
    SizeY=Slider(6, range=0..10),
    ExtentX=Slider(1, range=0..100),
    ExtentY=Slider(22, range=0..100))  # -> simplify(Cells), Points
tstat = TreeStatistics(Tree=recgrid.Cells)  # -> Paths, Length, Count
item = ListItem(List=tstat.Paths, Index=0, Wrap=True)
branch = TreeBranch(Tree=recgrid.Cells, Path=item, MaintainPaths=True)
cp = ControlPoints(Curve=branch)  # -> Points, Weights, Knots
cull_i = CullIndex(List=cp.Points, Indices=0, Wrap=True)
dispatch = Dispatch(List=cull_i, DispatchPattern=[True, False])  # -> ListA, ListB
pline = PolyLine(Vertices=dispatch.ListA, Closed=False)
pline_2 = PolyLine(Vertices=dispatch.ListB, Closed=False)
merge = Merge(Data1=pline, Data2=pline_2)  # -> simplify(Result)
group = Group(Objects=merge)  # -> flatten(Group)
dispatch_2 = Dispatch(List=group, DispatchPattern=[True, False])  # -> ListA, ListB
ungroup = Ungroup(Group=dispatch_2.ListA)
ungroup_2 = Ungroup(Group=dispatch_2.ListB)
item_2 = ListItem(List=ungroup_2, Index=1, Wrap=True)
item_3 = ListItem(List=ungroup, Index=0, Wrap=True)
merge_2 = Merge(Data1=item_3, Data2=item_2)  # -> flatten(Result)
join = JoinCurves(Curves=merge_2, Preserve=False)
cp_2 = ControlPoints(Curve=join)  # -> Points, Weights, Knots
intcrv = Interpolate(Vertices=cp_2.Points, Degree=3, Periodic=False, KnotStyle=1)  # -> Curve, Length, Domain
mirror = Mirror(Geometry=intcrv.Curve, Plane=PlaneYZ(0, 0, 0))  # -> Geometry, Transform
series = Series(Start=0, Step=Slider(15, range=0..100), Count=Slider(50, range=0..100))
merge_3 = Merge(Data1=intcrv.Curve, Data2=mirror.Geometry)
rad = Radians(Degrees=series)
group_2 = Group(Objects=merge_3)
sin = Sine(Value=rad)
dom = ConstructDomain(DomainStart=Slider(0.5, range=0..1), DomainEnd=Slider(1.5, range=0..10))
bbox = BoundingBox(Content=group_2, Plane=PlaneXY(0, 0, 0))  # -> Box, Box_2
bnd = Bounds(Numbers=sin)
area = Area(Geometry=bbox.Box)  # -> Area, Centroid
remap = RemapNumbers(Value=sin, Source=bnd, Target=dom)  # -> Mapped, Clipped
scale_nu = ScaleNU(Geometry=group_2, Plane=area.Centroid, ScaleX=remap.Mapped, ScaleY=1, ScaleZ=1)  # -> Geometry, Transform
bbox_2 = BoundingBox(Content=scale_nu.Geometry, Plane=PlaneXY(0, 0, 0))  # -> Box, Box_2
debox = DeconstructBox(Box=bbox_2.Box)  # -> Plane, X, Y, Z
dedomain = DeconstructDomain(Domain=debox.X)  # -> Start, End
subtraction = Subtraction(A=dedomain.End, B=dedomain.Start)
cos = Cosine(Value=rad)
consec = ConsecutiveDomains(Numbers=subtraction, Additive=True)
dom_2 = ConstructDomain(DomainStart=Slider(5.7, range=0..10), DomainEnd=Slider(20.2, range=0..30))
bnd_2 = Bounds(Numbers=sin)
dedomain_2 = DeconstructDomain(Domain=consec)  # -> Start, End
remap_2 = RemapNumbers(Value=cos, Source=bnd_2, Target=dom_2)  # -> Mapped, Clipped
X = UnitX(Factor=dedomain_2.Start)
Z = UnitZ(Factor=remap_2.Mapped)
move = Move(Geometry=scale_nu.Geometry, Motion=X)  # -> Geometry, Transform
graft = GraftTree(Tree=Z, IncludeEmptyLists=True, IncludeNullItems=True)  # -> simplify(Tree)
ungroup_3 = Ungroup(Group=move.Geometry)
extr = Extrude(Base=ungroup_3, Direction=graft)
flatten = FlattenTree(Tree=extr, Path="{0}")
lng = ListLength(List=flatten)
range = Range(Domain=Domain(0, 1), Steps=expr("x-1", lng))
frgb = ColourRGBF(Alpha=1, Red=range, Green=0, Blue=0)
graft_2 = GraftTree(Tree=frgb, IncludeEmptyLists=True, IncludeNullItems=True)
preview = CustomPreview(Geometry=extr, Material=graft_2)
