# Grasshopper definition 11-Leaf Dome.gh (Grasshopper 1.0.7)

pt = ConstructPoint(XCoordinate=0, YCoordinate=0, ZCoordinate=0)
X = UnitX(Factor=1)
line = LineSDL(Start=pt, Direction=X, Length=Slider(100, range=0..100))
divide = DivideCurve(Curve=reparameterize(line), Count=Slider(20, range=0..100), Kinks=False)  # -> Points, Tangents, Parameters
graph = GraphMapper(
    divide.Parameters,
    x0=0,
    x1=1,
    y0=0,
    y1=1,
    container_name="Bezier",
    cpx=[0, 0.3612520397, 0.2336231172, 1],
    cpy=[0.7081159353, 0.3801391125, 0, 0])
bnd = Bounds(Numbers=graph)
number_slider = Slider(65, range=0..100)
Z = UnitZ(Factor=Slider(96.08, range=0..100))
remap = RemapNumbers(Value=graph, Source=bnd, Target=Z)  # -> Mapped, Clipped
Z_2 = UnitZ(Factor=remap.Mapped)
mod = Modulus(A=number_slider, B="2")
addition = Addition(A=number_slider, B=mod)
move = Move(Geometry=divide.Points, Motion=Z_2)  # -> Geometry, Transform
pi = Pi(Factor="2")
range = Range(Domain=pi, Steps=addition)  # -> reverse(Range)
group = Group(Objects=move.Geometry)
cull_i = CullIndex(List=range, Indices=0, Wrap=True)
rotate = Rotate(Geometry=group, Angle=cull_i, Plane=PlaneXY(0, 0, 0))  # -> Geometry, Transform
dispatch = Dispatch(List=rotate.Geometry, DispatchPattern=[True, False])  # -> ListA, ListB
ungroup = Ungroup(Group=rotate.Geometry)  # -> simplify(Objects)
lng = ListLength(List=dispatch.ListA)
lng_2 = ListLength(List=dispatch.ListB)
item = ListItem(List=reverse(ungroup), Index=0, Wrap=True)
item_2 = ListItem(List=ungroup, Index=0, Wrap=True)
project = Project(Geometry=item_2, Plane=PlaneXY(0, 0, 0))  # -> Geometry, Transform
project_2 = Project(Geometry=item, Plane=PlaneXY(0, 0, 0))  # -> Geometry, Transform
dom = ConstructDomain(DomainStart=Slider(1.12, range=0..2), DomainEnd=Slider(1.82, range=0..2))
dom_2 = ConstructDomain(DomainStart=Slider(0.2, range=0..1), DomainEnd=Slider(0.9, range=0..1))
vec2pt = Vector2Pt(PointA=project.Geometry, PointB=project_2.Geometry, Unitize=False)  # -> Vector, Length
pi_2 = Pi(Factor="0.5")
Z_3 = UnitZ(Factor=1)
random = Random(Range=dom_2, Number=lng, Seed=2)
random_2 = Random(Range=dom, Number=lng_2, Seed=2)
vrot = Rotate(Vector=vec2pt.Vector, Axis=Z_3, Angle=pi_2)
weave = Weave(Pattern=[0, 1], Stream0=random, Stream1=random_2, NullGaps=False)  # -> graft(Weave)
pl = ConstructPlane(Origin=pt, XAxis=vec2pt.Vector, YAxis=vrot)
scale_nu = ScaleNU(Geometry=ungroup, Plane=pl, ScaleX=weave, ScaleY=1, ScaleZ=1)  # -> simplify(Geometry), Transform
flip = FlipMatrix(Data=scale_nu.Geometry)
viewer = ParamViewer(scale_nu.Geometry)
viewer_2 = ParamViewer(flip)
item_3 = ListItem(List=viewer_2, Index=0, Wrap=True)
split = SplitTree(Data=flip, Masks=flatten(item_3))  # -> Positive, Negative
makepair = MakePair(x=split.Negative, loop=Toggle(False))  # -> out, A; inputs x: tree, loop: Boolean
# ---------- makepair: C# usings ----------
using System.IO;
using System.Linq;
using System.Data;
using System.Drawing;
using System.Reflection;
using System.Windows.Forms;
using System.Xml;
using System.Xml.Linq;
using System.Runtime.InteropServices;

using Rhino.DocObjects;
using Rhino.Collections;
using GH_IO;
using GH_IO.Serialization;
# ---------- makepair: C# ----------
    DataTree<object> tree = new DataTree<object>();
    for(int i = 0; i < x.BranchCount; i++){
      List<object> planes = x.Branches[i];
      GH_Path pathO = x.Paths[i];
      int[] sample = new int[pathO.Length + 1];

      for(int t = 0; t < pathO.Length - 1; t++){
        sample[t] = pathO[t];
      }


      for(int n = 0; n < x.Branches[i].Count; n++){
        sample[pathO.Length - 1] = i;
        sample[pathO.Length] = n;

        GH_Path path = new GH_Path(sample);
        if(n < x.Branches[i].Count - 1){
          tree.Add(planes[n], path);
          tree.Add(planes[n + 1], path);
        }else if(loop){
          tree.Add(planes[x.Branches[i].Count - 1], path);
          tree.Add(planes[0], path);
        }

      }
    }

    A = tree;
# ---------- end makepair ----------
pline = PolyLine(Vertices=makepair.A, Closed=False)
pshift = ShiftPaths(Data=pline, Offset=-1)
dispatch_2 = Dispatch(List=pshift, DispatchPattern=[True, False])  # -> ListA, ListB
crv = Curve(dispatch_2.ListA)
flip_2 = FlipCurve(Curve=dispatch_2.ListB)  # -> Curve, Flag
weave_2 = Weave(Pattern=[0, 1], Stream0=crv, Stream1=flip_2.Curve, NullGaps=False)
flip_3 = FlipMatrix(Data=weave_2)
makepair_2 = MakePair(x=flip_3, loop=Toggle(False))  # -> out, simplify(A); inputs x: tree, loop: Boolean
# ---------- makepair_2: C# ----------
    DataTree<object> tree = new DataTree<object>();
    for(int i = 0; i < x.BranchCount; i++){
      List<object> planes = x.Branches[i];
      GH_Path pathO = x.Paths[i];
      int[] sample = new int[pathO.Length + 1];

      for(int t = 0; t < pathO.Length - 1; t++){
        sample[t] = pathO[t];
      }


      for(int n = 0; n < x.Branches[i].Count; n++){
        sample[pathO.Length - 1] = i;
        sample[pathO.Length] = n;

        GH_Path path = new GH_Path(sample);
        if(n < x.Branches[i].Count - 1){
          tree.Add(planes[n], path);
          tree.Add(planes[n + 1], path);
        }else if(loop){
          tree.Add(planes[x.Branches[i].Count - 1], path);
          tree.Add(planes[0], path);
        }

      }
    }

    A = tree;
# ---------- end makepair_2 ----------
end = EndPoints(Curve=makepair_2.A)  # -> Start, End
pt_2 = Point(end.End)
pline_2 = PolyLine(Vertices=pt_2, Closed=False)
eval = EvaluateLength(Curve=pline_2, Length="0.5", Normalized=True)  # -> Point, Tangent, Parameter
scale = Scale(Geometry=pline_2, Center=eval.Point, Factor=Slider(0.044, range=0..1))  # -> Geometry, Transform
pline_3 = PolyLine(Vertices=end.Start, Closed=False)
merge = Merge(Data1=pline_3, Data2=scale.Geometry)
loft = Loft(Curves=merge, Options={Adjust=False, Closed=False, LoftEnds=0, LoftSimp=0, LoftType=0, Rebuild=10, Refit=0.01})
pshift_2 = ShiftPaths(Data=loft, Offset=-1)
flip_4 = FlipMatrix(Data=pshift_2)
join = BrepJoin(Breps=flip_4)  # -> flatten(Breps), Closed
lng_3 = ListLength(List=join.Breps)  # -> expr("x-1", Length)
range_2 = Range(Domain=Domain(0, 1), Steps=lng_3)
gradient = Gradient(LowerLimit=0, UpperLimit=1, Parameter=range_2, stops=[0.257: RGB(197, 252, 169), 0.924: RGB(31, 71, 24)])
preview = CustomPreview(Geometry=join.Breps, Shader=gradient)
