# Grasshopper definition 12-Column Shelf.gh (Grasshopper 1.0.7)
# plug-ins: Kangaroo Components

Z = UnitZ(Factor=Slider(2000, range=0..10000))
cir = Circle(Plane=PlaneXY(0, 0, 0), Radius=Slider(503, range=0..1000))
extr = Extrude(Base=cir, Direction=Z)
sdivide = DivideSurface(Surface=extr, UCount=Slider(10, range=0..100), VCount=Slider(15, range=0..100))  # -> simplify(Points), Normals, Parameters
flip = FlipMatrix(Data=sdivide.Points)
pline = PolyLine(Vertices=flip, Closed=False)  # -> simplify(flatten(Polyline))
panel = Panel("""0
1""")
cull_i = CullIndex(List=pline, Indices=0, Wrap=True)
lng = ListLength(List=cull_i)
random = Random(Range=Slider(32432, range=0..100000), Number=lng, Seed=Slider(234, range=0..1000), Integers=True)
dup = DuplicateData(Data=graft(panel), Number=lng, Order=True)
makepair = MakePair(x=cull_i, loop=Toggle(True))  # -> out, simplify(A); inputs x: tree, loop: Boolean
# ---------- makepair: C# usings ----------
using System.IO;
using System.Linq;
using System.Data;
using System.Drawing;
using System.Reflection;
using System.Windows.Forms;
using System.Xml;
using System.Xml.Linq;
using System.Runtime.InteropServices;

using Rhino.DocObjects;
using Rhino.Collections;
using GH_IO;
using GH_IO.Serialization;
# ---------- makepair: C# ----------
    DataTree<object> tree = new DataTree<object>();
    for(int i = 0; i < x.BranchCount; i++){
      List<object> planes = x.Branches[i];
      GH_Path pathO = x.Paths[i];
      int[] sample = new int[pathO.Length + 1];

      for(int t = 0; t < pathO.Length - 1; t++){
        sample[t] = pathO[t];
      }


      for(int n = 0; n < x.Branches[i].Count; n++){
        sample[pathO.Length - 1] = i;
        sample[pathO.Length] = n;

        GH_Path path = new GH_Path(sample);
        if(n < x.Branches[i].Count - 1){
          tree.Add(planes[n], path);
          tree.Add(planes[n + 1], path);
        }else if(loop){
          tree.Add(planes[x.Branches[i].Count - 1], path);
          tree.Add(planes[0], path);
        }

      }
    }

    A = tree;
# ---------- end makepair ----------
flip_2 = FlipMatrix(Data=dup)  # -> simplify(Data)
random_2 = Random(Range=Domain(0, 1), Number=Slider(10, range=0..100), Seed=random)  # -> simplify(Random)
crv = Curve(makepair.A)
merge = Merge(Data1=flip_2, Data2=random_2)
item = ListItem(List=crv, Index=1, Wrap=True)
item_2 = ListItem(List=crv, Index=0, Wrap=True)
number_slider = Slider(100, range=0..1000)
eval = EvaluateCurve(Curve=reparameterize(item), Parameter=merge)  # -> Point, Tangent, Angle
eval_2 = EvaluateCurve(Curve=reparameterize(item_2), Parameter=merge)  # -> Point, Tangent, Angle
duppt = RemoveDuplicatePts(Points=eval.Point, Tolerance=number_slider)
duppt_2 = RemoveDuplicatePts(Points=eval_2.Point, Tolerance=number_slider)
ln = Line(StartPoint=duppt_2, EndPoint=duppt)
pdecon = Deconstruct(Point=duppt_2)  # -> XComponent, YComponent, ZComponent
sort = SortList(Keys=pdecon.ZComponent, ValuesA=ln)  # -> Keys, ValuesA
makepair_2 = MakePair(x=sort.ValuesA, loop=Toggle(False))  # -> out, A; inputs x: tree, loop: Boolean
# ---------- makepair_2: C# ----------
    DataTree<object> tree = new DataTree<object>();
    for(int i = 0; i < x.BranchCount; i++){
      List<object> planes = x.Branches[i];
      GH_Path pathO = x.Paths[i];
      int[] sample = new int[pathO.Length + 1];

      for(int t = 0; t < pathO.Length - 1; t++){
        sample[t] = pathO[t];
      }


      for(int n = 0; n < x.Branches[i].Count; n++){
        sample[pathO.Length - 1] = i;
        sample[pathO.Length] = n;

        GH_Path path = new GH_Path(sample);
        if(n < x.Branches[i].Count - 1){
          tree.Add(planes[n], path);
          tree.Add(planes[n + 1], path);
        }else if(loop){
          tree.Add(planes[x.Branches[i].Count - 1], path);
          tree.Add(planes[0], path);
        }

      }
    }

    A = tree;
# ---------- end makepair_2 ----------
loft = Loft(Curves=makepair_2.A, Options={Adjust=False, Closed=False, LoftEnds=0, LoftSimp=0, LoftType=0, Rebuild=10, Refit=0.01})
crv_2 = Curve(simplify(loft))
pln = Plane(loft)
neg = Negative(Value=Slider(15.46, range=0..30))
offset = Offset(Curve=crv_2, Distance=neg, Plane=pln, Corners=1)  # -> simplify(Curve)
merge_2 = Merge(Data1=offset, Data2=crv_2)
loft_2 = Loft(Curves=merge_2, Options={Adjust=False, Closed=False, LoftEnds=0, LoftSimp=0, LoftType=0, Rebuild=10, Refit=0.01})
area = Area(Geometry=loft_2)  # -> Area, Centroid
number_slider_2 = Slider(0.8, range=0..1)
pdecon_2 = Deconstruct(Point=area.Centroid)  # -> XComponent, YComponent, ZComponent
pt = ConstructPoint(XCoordinate=0, YCoordinate=0, ZCoordinate=pdecon_2.ZComponent)
scale_nu = ScaleNU(Geometry=loft_2, Plane=pt, ScaleX=number_slider_2, ScaleY=number_slider_2, ScaleZ=1)  # -> Geometry, Transform
edges = BrepEdges(Brep=loft_2)  # -> simplify(graft(Naked)), Interior, NonManifold
edges_2 = BrepEdges(Brep=scale_nu.Geometry)  # -> simplify(graft(Naked)), Interior, NonManifold
merge_3 = Merge(Data1=edges.Naked, Data2=edges_2.Naked)
loft_3 = Loft(Curves=merge_3, Options={Adjust=False, Closed=False, LoftEnds=0, LoftSimp=0, LoftType=0, Rebuild=10, Refit=0.01})
pshift = ShiftPaths(Data=loft_3, Offset=-1)
merge_4 = Merge(Data1=pshift, Data2=loft_2, Data3=scale_nu.Geometry)
join = BrepJoin(Breps=merge_4)  # -> Breps, Closed
lng_2 = ListLength(List=flatten(join.Breps))
random_3 = Random(Range=Domain(0, 1), Number=lng_2, Seed=2)
hsl = ColourHSL(Alpha=1, Hue=random_3, Saturation=Slider(0.67, range=0..1), Luminance=0.5)
preview = CustomPreview(Geometry=flatten(join.Breps), Shader=hsl)
