# Grasshopper definition 2-Triangle Holes.gh (Grasshopper 1.0.7)

number_slider = Slider(5, range=0..10)
hexgrid = Hexagonal(Plane=PlaneXY(0, 0, 0), Size=1, ExtentX=number_slider, ExtentY=number_slider)  # -> Cells, Points
area = Area(Geometry=hexgrid.Cells)  # -> Area, Centroid
extr = ExtrudePoint(Base=hexgrid.Cells, Point=area.Centroid)
flatten = FlattenTree(Tree=extr, Path="{0}")
join = BrepJoin(Breps=flatten)  # -> Breps, Closed
debrep = DeconstructBrep(Brep=flatten)  # -> Faces, Edges, Vertices
bbox = BoundingBox(Content=join.Breps, Plane=PlaneXY(0, 0, 0))  # -> Box, Box_2
flatten_2 = FlattenTree(Tree=debrep.Faces, Path="{0}")
debrep_2 = DeconstructBrep(Brep=bbox.Box)  # -> Faces, Edges, Vertices
crv = Curve(flatten_2)
md_slider = MDSlider(
    SliderMode=0,
    slider_value=Point(0.5248785252, 0.5957807215, 0.5),
    x_domain=Domain(0, 1),
    y_domain=Domain(0, 1),
    z_domain=Domain(0, 1))
item = ListItem(List=debrep_2.Faces, Index=0, Wrap=True)
srf = Surface(reparameterize(item))
area_2 = Area(Geometry=crv)  # -> Area, Centroid
evalsrf = EvaluateSurface(Surface=srf, Point=md_slider)  # -> Point, Normal, UDirection, VDirection, Frame
dist = Distance(PointA=area_2.Centroid, PointB=evalsrf.Point)
bnd = Bounds(Numbers=dist)
dom = ConstructDomain(DomainStart=Slider(0.05, range=0..0.1), DomainEnd=Slider(0.95, range=0..1))
remap = RemapNumbers(Value=dist, Source=bnd, Target=dom)  # -> Mapped, Clipped
graft = GraftTree(Tree=remap.Mapped, IncludeEmptyLists=True, IncludeNullItems=True)
dom_2 = ConstructDomain(DomainStart=graft, DomainEnd=Slider(0.1, range=0..0.1))  # -> simplify(Domain)
range = Range(Domain=dom_2, Steps=10)
range_2 = Range(Domain=Slider(1, range=0..1), Steps=10)
neg = Negative(Value=Slider(0.2, range=-0.5..0.5))
scale = Scale(Geometry=graft(crv), Center=graft(area_2.Centroid), Factor=range)  # -> simplify(Geometry), Transform
Z = UnitZ(Factor=range_2)
P = Plane(PlaneXY(0, 0, 0))
crv_2 = Curve(join.Breps)
offset = OffsetCurve(Curve=crv_2, Distance=neg, Plane=P, Corners=1)
neg_2 = Negative(Value=Z)
move = Move(Geometry=scale.Geometry, Motion=neg_2)  # -> simplify(Geometry), Transform
move_2 = Move(Geometry=offset, Motion=neg_2)  # -> simplify(graft(Geometry)), Transform
flip = FlipMatrix(Data=move.Geometry)
merge = Merge(Data1=flip, Data2=move_2.Geometry)
range_3 = Range(Domain=Domain(0, 1), Steps=10)
boundary = BoundarySurfaces(Edges=merge)
gradient = Gradient(LowerLimit=0, UpperLimit=1, Parameter=range_3, stops=[0.15: RGB(27, 227, 207), 0.85: RGB(98, 8, 255)])
graft_2 = GraftTree(Tree=gradient, IncludeEmptyLists=True, IncludeNullItems=True)
preview = CustomPreview(Geometry=boundary, Material=graft_2)
