# Grasshopper definition 3-Light Cage.gh (Grasshopper 1.0.7)

pt = ConstructPoint(XCoordinate=0, YCoordinate=0, ZCoordinate=0)
Z = UnitZ(Factor=1)
line = LineSDL(Start=pt, Direction=Z, Length=Slider(100, range=0..100))
divide = DivideCurve(Curve=reparameterize(line), Count=10, Kinks=False)  # -> Points, Tangents, Parameters
graph = GraphMapper(
    divide.Parameters,
    x0=0,
    x1=1,
    y0=0,
    y1=1,
    container_name="Bezier",
    cpx=[0, 0.217623502, 0.9338405728, 1],
    cpy=[0.3660143614, 0.02675354481, 0.01000005007, 1])
dom = ConstructDomain(DomainStart=Slider(42, range=0..100), DomainEnd="0")
remap = RemapNumbers(Value=graph, Source=Domain(0, 1), Target=dom)  # -> Mapped, Clipped
X = UnitX(Factor=remap.Mapped)
move = Move(Geometry=divide.Points, Motion=X)  # -> Geometry, Transform
number_slider = Slider(123, range=0..300)
intcrv = Interpolate(Vertices=move.Geometry, Degree=3, Periodic=False, KnotStyle=1)  # -> Curve, Length, Domain
revsrf = Revolution(Curve=intcrv.Curve, Axis=line, Domain=Domain(0, 6.283185307))
division = Division(A=number_slider, B="2")
edges = BrepEdges(Brep=revsrf)  # -> Naked, Interior, NonManifold
addition = Addition(A=number_slider, B=division)
crv = Curve(edges.Naked)
divide_2 = DivideCurve(Curve=crv, Count=addition, Kinks=False)  # -> Points, Tangents, Parameters
lng = ListLength(List=divide_2.Points)
division_2 = Division(A=lng, B="2")
random = Random(Range=Domain(0, 1), Number=lng, Seed=2)
sort = SortList(Keys=random, ValuesA=divide_2.Points)  # -> Keys, ValuesA
split = SplitList(List=sort.ValuesA, Index=division_2)  # -> ListA, ListB
ln = Line(StartPoint=split.ListA, EndPoint=split.ListB)
eval = EvaluateLength(Curve=ln, Length=Slider(0.5, range=0..1), Normalized=True)  # -> Point, Tangent, Parameter
vec = Vector(ln)
random_2 = Random(Range=Slider(40, range=0..100), Number=division_2, Seed=Slider(2342, range=0..10000))
Z_2 = UnitZ(Factor=eval.Point)
number_slider_2 = Slider(1, range=0..1)
rad = Radians(Degrees=random_2)
vrot = Rotate(Vector=Z_2, Axis=vec, Angle=rad)
neg = Negative(Value=number_slider_2)
pl = ConstructPlane(Origin=eval.Point, XAxis=vec, YAxis=vrot)
merge = Merge(Data1=neg, Data2=number_slider_2)
graft = GraftTree(Tree=pl, IncludeEmptyLists=True, IncludeNullItems=True)
pl_offset = PlaneOffset(BasePlane=graft, Offset=merge)  # -> simplify(Plane)
srf = Surface(revsrf)
sec = BrepPlane(Brep=srf, Plane=pl_offset)  # -> reparameterize(simplify(Curves)), Points
pshift = ShiftPaths(Data=sec.Curves, Offset=-1)
cls = Closed(Curve=pshift)  # -> Closed, Periodic
lng_2 = ListLength(List=pshift)
ma = MassAddition(Input=cls.Closed)  # -> Result, PartialResults
equals = Equality(FirstNumber=lng_2, SecondNumber="2")  # -> Equality, Inequality
equals_2 = Equality(FirstNumber=ma.Result, SecondNumber="0")  # -> Equality, Inequality
and = GateAnd(A=equals_2.Equality, B=equals.Equality)
cull = CullPattern(List=pshift, CullPattern=and)
prune = PruneTree(Tree=cull, Minimum="1", Maximum=0)
number_slider_3 = Slider(100, range=0..100)
item = ListItem(List=prune, Index="1", Wrap=True)
item_2 = ListItem(List=prune, Index=0, Wrap=True)
divide_3 = DivideCurve(Curve=item_2, Count=number_slider_3, Kinks=False)  # -> simplify(Points), Tangents, Parameters
divide_4 = DivideCurve(Curve=item, Count=number_slider_3, Kinks=False)  # -> simplify(Points), Tangents, Parameters
ln_2 = Line(StartPoint=divide_3.Points, EndPoint=divide_4.Points)
eval_2 = EvaluateLength(Curve=ln_2, Length="0.5", Normalized=True)  # -> Point, Tangent, Parameter
pdecon = Deconstruct(Point=eval_2.Point)  # -> XComponent, YComponent, ZComponent
dom_2 = ConstructDomain(DomainStart=Slider(2, range=0..2), DomainEnd=Slider(0.2, range=0..1))
bnd = Bounds(Numbers=flatten(pdecon.ZComponent))
remap_2 = RemapNumbers(Value=pdecon.ZComponent, Source=bnd, Target=dom_2)  # -> Mapped, Clipped
scale = Scale(Geometry=ln_2, Center=eval_2.Point, Factor=remap_2.Mapped)  # -> Geometry, Transform
loft = Loft(Curves=scale.Geometry, Options={Adjust=False, Closed=False, LoftEnds=0, LoftSimp=0, LoftType=0, Rebuild=10, Refit=0.01})
mesh = Mesh(loft)
demesh = DeconstructMesh(Mesh=mesh)  # -> Vertices, Faces, Colours, Normals
pdecon_2 = Deconstruct(Point=demesh.Vertices)  # -> XComponent, YComponent, ZComponent
bnd_2 = Bounds(Numbers=flatten(pdecon_2.ZComponent))
remap_3 = RemapNumbers(Value=pdecon_2.ZComponent, Source=bnd_2, Target=Domain(0, 1))  # -> Mapped, Clipped
gradient = Gradient(LowerLimit=0, UpperLimit=1, Parameter=remap_3.Mapped, stops=[0.15: RGB(0, 250, 79), 0.85: RGB(0, 58, 219)])
mcol = MeshColours(Mesh=mesh, Colours=gradient)
