# Grasshopper definition 4-Mushroom Hat.gh (Grasshopper 1.0.7)

number_slider = Slider(100, range=0..100)
planesrf = PlaneSurface(Plane=PlaneXY(0, 0, 0), XSize=number_slider, YSize=number_slider)
area = Area(Geometry=planesrf)  # -> Area, Centroid
polygon = Polygon(Plane=area.Centroid, Radius=Slider(45, range=0..100), Segments=6, FilletRadius=0)  # -> Polygon, Length
cp = ControlPoints(Curve=polygon.Polygon)  # -> Points, Weights, Knots
cull_i = CullIndex(List=cp.Points, Indices="0", Wrap=True)
shift = ShiftList(List=cull_i, Shift=Slider(2, range=0..10), Wrap=True)
number_slider_2 = Slider(15, range=0..100)
ln = Line(StartPoint=cull_i, EndPoint=shift)
number_slider_3 = Slider(34, range=0..100)
join = JoinCurves(Curves=ln, Preserve=False)
subtraction = Subtraction(A=number_slider_2, B="1")
pi = Pi(Factor=Slider(4, range=0..10))
runion = RegionUnion(Curves=join)
range = Range(Domain=pi, Steps=subtraction)
boundary = BoundarySurfaces(Edges=runion)  # -> reparameterize(Surfaces)
sdivide = DivideSurface(Surface=planesrf, UCount=number_slider_3, VCount=number_slider_3)  # -> Points, Normals, Parameters
sin = Sine(Value=range)
bnd = Bounds(Numbers=flatten(sin))
dom = ConstructDomain(DomainStart=Slider(0.1, range=0..0.5), DomainEnd=Slider(0.5, range=0..1))
srf_cp = SurfaceClosestPoint(Point=sdivide.Points, Surface=boundary)  # -> Point, UVPoint, Distance
area_2 = Area(Geometry=runion)  # -> Area, Centroid
remap = RemapNumbers(Value=sin, Source=bnd, Target=dom)  # -> Mapped, Clipped
bnd_2 = Bounds(Numbers=flatten(srf_cp.Distance))
dom_2 = ConstructDomain(DomainStart=Slider(72, range=0..100), DomainEnd=Slider(0, range=0..100))
scale = Scale(Geometry=runion, Center=area_2.Centroid, Factor=remap.Mapped)  # -> Geometry, Transform
remap_2 = RemapNumbers(Value=srf_cp.Distance, Source=bnd_2, Target=dom_2)  # -> Mapped, Clipped
Z = UnitZ(Factor=remap_2.Mapped)
cir = Circle(Plane=area_2.Centroid, Radius=Slider(43, range=0..100))
move = Move(Geometry=sdivide.Points, Motion=Z)  # -> Geometry, Transform
divide = DivideCurve(Curve=cir, Count=number_slider_2, Kinks=False)  # -> Points, Tangents, Parameters
vec2pt = Vector2Pt(PointA=area_2.Centroid, PointB=divide.Points, Unitize=False)  # -> Vector, Length
move_2 = Move(Geometry=scale.Geometry, Motion=vec2pt.Vector)  # -> Geometry, Transform
graft = GraftTree(Tree=move_2.Geometry, IncludeEmptyLists=True, IncludeNullItems=True)
flatten = FlattenTree(Tree=move.Geometry, Path="{0}")
srf_cp_2 = SurfaceClosestPoint(Point=flatten, Surface=reparameterize(graft))  # -> Point, UVPoint, simplify(Distance)
addition = Addition(A=number_slider_3, B="1")
flip = FlipMatrix(Data=srf_cp_2.Distance)
srfgrid = SurfaceFromPoints(Points=flatten, UCount=addition, Interpolate=False)
ma = MassAddition(Input=flip)  # -> Result, PartialResults
srf_cp_3 = SurfaceClosestPoint(Point=flatten, Surface=reparameterize(srfgrid))  # -> Point, UVPoint, Distance
bnd_3 = Bounds(Numbers=flatten(ma.Result))
evalsrf = EvaluateSurface(Surface=reparameterize(srfgrid), Point=srf_cp_3.UVPoint)  # -> Point, Normal, UDirection, VDirection, Frame
remap_3 = RemapNumbers(Value=ma.Result, Source=bnd_3, Target=Slider(30, range=0..100))  # -> flatten(Mapped), Clipped
amp = Amplitude(Vector=evalsrf.Normal, Amplitude=remap_3.Mapped)
move_3 = Move(Geometry=evalsrf.Point, Motion=amp)  # -> Geometry, Transform
srfgrid_2 = SurfaceFromPoints(Points=move_3.Geometry, UCount=addition, Interpolate=False)
preview = CustomPreview(
    Geometry=srfgrid_2,
    Material={diffuse=RGB(221, 160, 221), emission=RGB(66, 48, 66), shine=0.5, specular=RGB(255, 255, 255), transparency=0})
