# Grasshopper definition 5-Egg Bullet with Kangaroo 2.gh (Grasshopper 1.0.7)
# plug-ins: MeshEdit Components, Kangaroo Components, Kangaroo2 Components

number_slider = Slider(100, range=0..100)
planesrf = PlaneSurface(Plane=PlaneXY(0, 0, 0), XSize=number_slider, YSize=number_slider)
area = Area(Geometry=planesrf)  # -> Area, Centroid
Z = UnitZ(Factor=Slider(68, range=0..100))
move = Move(Geometry=area.Centroid, Motion=Z)  # -> Geometry, Transform
sph = Sphere(Base=move.Geometry, Radius=Slider(18, range=0..100))
xy = XYPlane(Origin=move.Geometry)
sec = BrepPlane(Brep=sph, Plane=xy)  # -> Curves, Points
srfsplit = SurfaceSplit(Surface=sph, Curves=sec.Curves)
bbox = BoundingBox(Content=srfsplit, Plane=PlaneXY(0, 0, 0))  # -> Box, Box_2
area_2 = Area(Geometry=bbox.Box)  # -> Area, Centroid
pdecon = Deconstruct(Point=area_2.Centroid)  # -> XComponent, YComponent, ZComponent
sort = SortList(Keys=pdecon.ZComponent, ValuesA=srfsplit)  # -> Keys, ValuesA

# ---- group: 下半球面
item = ListItem(List=sort.ValuesA, Index=0, Wrap=True)

# ---- group: 下半球面延Z轴缩放
bbox_2 = BoundingBox(Content=item, Plane=PlaneXY(0, 0, 0))  # -> Box, Box_2
debrep = DeconstructBrep(Brep=bbox_2.Box)  # -> Faces, Edges, Vertices
area_3 = Area(Geometry=debrep.Faces)  # -> Area, Centroid
pdecon_2 = Deconstruct(Point=area_3.Centroid)  # -> XComponent, YComponent, ZComponent
sort_2 = SortList(Keys=pdecon_2.ZComponent, ValuesA=area_3.Centroid)  # -> Keys, reverse(ValuesA)
item_2 = ListItem(List=sort_2.ValuesA, Index=0, Wrap=True)
scale_nu = ScaleNU(Geometry=item, Plane=item_2, ScaleX=1, ScaleY=1, ScaleZ=Slider(1.8, range=0..10))  # -> Geometry, Transform

# ----
number_slider_2 = Slider(20, range=0..100)
sdivide = DivideSurface(Surface=planesrf, UCount=number_slider_2, VCount=number_slider_2)  # -> Points, Normals, Parameters
addition = Addition(A=number_slider_2, B="1")
flatten = FlattenTree(Tree=sdivide.Points, Path="{0}")

# ---- group: 上半球面
item_3 = ListItem(List=sort.ValuesA, Index="1", Wrap=True)

# ----
frompoints = MeshFromPoints(Points=flatten, UDirection=addition, VDirection=addition)
merge = Merge(Data1=scale_nu.Geometry, Data2=item_3)

# ---- group: 得到上半球面在投影面内的点，并使之锚固在上边球面 / 上半球面
srf = Surface(item_3)

# ----
join = BrepJoin(Breps=flatten(merge))  # -> Breps, Closed

# ---- group: 得到上半球面在投影面内的点，并使之锚固在上边球面
project = Project(Geometry=srf, Plane=planesrf)  # -> Geometry, Transform
crv = Curve(project.Geometry)
incurve = PointInCurve(Point=flatten, Curve=crv)  # -> Relationship, Point
equals = Equality(FirstNumber=incurve.Relationship, SecondNumber=Slider(2, range=0..10))  # -> Equality, Inequality
graft = GraftTree(Tree=flatten, IncludeEmptyLists=True, IncludeNullItems=True)
graft_2 = GraftTree(Tree=equals.Equality, IncludeEmptyLists=True, IncludeNullItems=True)
dispatch = Dispatch(List=graft, DispatchPattern=graft_2)  # -> ListA, ListB
pt = Point(dispatch.ListA)
Z_2 = UnitZ(Factor=1)
project_2 = ProjectPoint(Point=pt, Direction=Z_2, Geometry=srf)  # -> Point, Index
anchor = Anchor(Point=pt, Target=project_2.Point, Strength=Slider(176.4, range=0..200))

# ----
scale = Scale(Geometry=join.Breps, Center=move.Geometry, Factor=Slider(0.82, range=0..1))  # -> Geometry, Transform
bbox_3 = BoundingBox(Content=scale.Geometry, Plane=PlaneXY(0, 0, 0))  # -> Box, Box_2
box_corners = BoxCorners(Box=bbox_3.Box)  # -> CornerA, CornerB, CornerC, CornerD, CornerE, CornerF, CornerG, CornerH
ln = Line(StartPoint=box_corners.CornerA, EndPoint=box_corners.CornerC)
number_slider_3 = Slider(22, range=0..100)

# ---- group: 锚固边缘点
medges = MeshEdges(Mesh=frompoints)  # -> NakedEdges, InteriorEdges, NonManifoldEdges
join_2 = JoinCurves(Curves=medges.NakedEdges, Preserve=False)
cp = ControlPoints(Curve=join_2)  # -> Points, Weights, Knots
duppt = RemoveDuplicatePts(Points=cp.Points, Tolerance=0.01)
anchor_2 = Anchor(Point=duppt, Strength=1000)  # -> flatten(A)

# ---- group: 网格不变形
explode = MeshExplode(Mesh=frompoints, Interpolate=False)
medges_2 = MeshEdges(Mesh=explode)  # -> NakedEdges, InteriorEdges, NonManifoldEdges
join_3 = JoinCurves(Curves=medges_2.NakedEdges, Preserve=False)
cp_2 = ControlPoints(Curve=join_3)  # -> Points, Weights, Knots
duppt_2 = RemoveDuplicatePts(Points=cp_2.Points, Tolerance=0.01)
dispatch_2 = Dispatch(List=duppt_2, DispatchPattern=[True, False])  # -> ListA, ListB
pline = PolyLine(Vertices=dispatch_2.ListA, Closed=False)
pline_2 = PolyLine(Vertices=dispatch_2.ListB, Closed=False)
merge_2 = Merge(Data1=medges.NakedEdges, Data2=medges.InteriorEdges, Data3=pline, Data4=pline_2)  # -> flatten(Result)
dupln = RemoveDuplicateLines(Lines=merge_2, Tolerance=0.01)
length_line = LengthLine(Line=dupln, Strength=Slider(10, range=0..100))  # -> flatten(Spring)

# ---- group: 力
neg = Negative(Value=Slider(4.55, range=0..10))
Z_3 = UnitZ(Factor=neg)
load = Load(Point=flatten, ForceVector=Z_3)  # -> flatten(Unary)

# ----
eval = EvaluateLength(Curve=ln, Length=0.5, Normalized=True)  # -> Point, Tangent, Parameter
show = Show(G=frompoints)  # -> flatten(G)
ln_2 = Line(StartPoint=eval.Point, EndPoint=area.Centroid)
random = Random(Range=Domain(0, 1), Number=number_slider_3, Seed=Slider(234, range=0..1000))
random_2 = Random(Range=Domain(0, 1), Number=number_slider_3, Seed=Slider(423, range=0..1000))
eval_2 = EvaluateLength(Curve=ln_2, Length=random, Normalized=True)  # -> Point, Tangent, Parameter
number_slider_4 = Slider(0, range=0..1)
dom = ConstructDomain(DomainStart=Slider(9.29, range=0..20), DomainEnd=number_slider_4)
dom_2 = ConstructDomain(DomainStart=Slider(2.96, range=0..20), DomainEnd=number_slider_4)
merge_3 = Merge(Data1=show, Data2=anchor_2, Data3=anchor, Data4=length_line, Data5=load)
remap = RemapNumbers(Value=random, Source=Domain(0, 1), Target=dom_2)  # -> Mapped, Clipped
remap_2 = RemapNumbers(Value=random, Source=Domain(0, 1), Target=dom)  # -> Mapped, Clipped
cir = Circle(Plane=eval_2.Point, Radius=remap_2.Mapped)
solver = Solver(GoalObjects=merge_3, Reset=Button(), Threshold=1e-15, Tolerance=0.01, On=Toggle(True))  # -> I, V, O
eval_3 = EvaluateCurve(Curve=reparameterize(cir), Parameter=random_2)  # -> Point, Tangent, Angle
item_4 = ListItem(List=solver.O, Index=0, Wrap=True)
sph_2 = Sphere(Base=eval_3.Point, Radius=remap.Mapped)
msmooth = SmoothMesh(Mesh=item_4, Strength=0.5, SkipNaked=True, Iterations=Slider(1, range=0..10))
merge_4 = Merge(Data1=scale.Geometry, Data2=sph_2)  # -> flatten(Result)
preview = CustomPreview(Geometry=msmooth, Shader=ColourSwatch(SwatchColor=RGBA(0, 229, 255, 123)))
preview_2 = CustomPreview(Geometry=merge_4, Shader=ColourSwatch(SwatchColor=RGB(255, 144, 0)))
