# Grasshopper definition 6-Drop Bubble.gh (Grasshopper 1.0.7)
# plug-ins: Kangaroo Components

pt = ConstructPoint(XCoordinate=0, YCoordinate=0, ZCoordinate=0)
number_slider = Slider(20, range=0..100)
sph = Sphere(Base=pt, Radius=Slider(100, range=0..100))
sdivide = DivideSurface(Surface=sph, UCount=number_slider, VCount=number_slider)  # -> flatten(Points), Normals, Parameters
pdecon = Deconstruct(Point=sdivide.Points)  # -> XComponent, YComponent, ZComponent
pt_2 = ConstructPoint(XCoordinate=0, YCoordinate=0, ZCoordinate=pdecon.ZComponent)
dist = Distance(PointA=pt, PointB=pt_2)
bnd = Bounds(Numbers=dist)
larger = LargerThan(FirstNumber=pdecon.ZComponent, SecondNumber=0)  # -> LargerThan, OrEqualTo
remap = RemapNumbers(Value=dist, Source=bnd, Target=Domain(0, 1))  # -> Mapped, Clipped
graph = GraphMapper(remap.Mapped, x0=0, x1=1, y0=0, y1=1, container_name="Bezier", cpx=[0, 0.4257396758, 1, 1], cpy=[0, 0, 0, 0.4125797153])
graph_2 = GraphMapper(
    remap.Mapped,
    x0=0,
    x1=1,
    y0=0,
    y1=1,
    container_name="Bezier",
    cpx=[0, 0.004348091315, 0.4797106683, 1],
    cpy=[0, 0.6275362372, 0.7318840623, 0.702898562])
multiplication = Multiplication(A=larger.LargerThan, B=graph)
addition = Addition(A=multiplication, B=graph_2)
scale_nu = ScaleNU(Geometry=sdivide.Points, Plane=pt, ScaleX=1, ScaleY=1, ScaleZ=addition)  # -> Geometry, Transform
addition_2 = Addition(A=number_slider, B="1")
srfgrid = SurfaceFromPoints(Points=scale_nu.Geometry, UCount=addition_2, Interpolate=False)
edges = BrepEdges(Brep=srfgrid)  # -> Naked, Interior, NonManifold
bbox = BoundingBox(Content=srfgrid, Plane=PlaneXY(0, 0, 0))  # -> Box, Box_2
pop3d = Populate3D(Region=bbox.Box, Count=100, Seed=1)
voronoi³ = Voronoi3D(Points=pop3d, Box=bbox.Box)  # -> Cells, Boundary
sint = SolidIntersection(BrepsA=voronoi³.Cells, BrepsB=srfgrid)
crv = Curve(edges.Interior)
edges_2 = BrepEdges(Brep=sint)  # -> Naked, Interior, NonManifold
crv_2 = Curve(edges_2.Interior)
graft = GraftTree(Tree=crv_2, IncludeEmptyLists=True, IncludeNullItems=True)
end = EndPoints(Curve=graft)  # -> Start, End
merge = Merge(Data1=end.Start, Data2=end.End)  # -> simplify(Result)
crv_cp = CurveClosestPoint(Point=merge, Curve=crv)  # -> Point, Parameter, Distance
smaller = SmallerThan(FirstNumber=crv_cp.Distance, SecondNumber=Slider(0.01, range=0..0.01))  # -> SmallerThan, OrEqualTo
mm = MassMultiplication(Input=smaller.SmallerThan)  # -> Result, PartialResults
bool = Boolean(mm.Result)
not = GateNot(A=bool)
pshift = ShiftPaths(Data=not, Offset=-1)
cull = CullPattern(List=crv_2, CullPattern=pshift)  # -> flatten(List)
end_2 = EndPoints(Curve=cull)  # -> Start, End
ln = Line(StartPoint=end_2.Start, EndPoint=end_2.End)
dupln = RemoveDuplicateLines(Lines=ln, Tolerance=0.01)
