# Grasshopper definition 7-Square Lettuce.gh (Grasshopper 1.0.7)

number_slider = Slider(10, range=0..100)
number_slider_2 = Slider(5, range=0..10)
rectangle = Rectangle(Plane=PlaneXY(0, 0, 0), XSize=number_slider, YSize=number_slider, Radius=0)  # -> Rectangle, Length
dom = ConstructDomain(DomainStart=Slider(0.1, range=0..1), DomainEnd=Slider(0.3, range=0..1))
range = Range(Domain=dom, Steps=number_slider_2)
range_2 = Range(Domain=Slider(4, range=0.1..4), Steps=number_slider_2)
pop2d = Populate2D(Region=rectangle.Rectangle, Count=Slider(20, range=0..100), Seed=Slider(271, range=0..1000))
graft = GraftTree(Tree=range, IncludeEmptyLists=True, IncludeNullItems=True)
graft_2 = GraftTree(Tree=range_2, IncludeEmptyLists=True, IncludeNullItems=True)
fspin = SpinForce(Plane=pop2d, Strength=1, Radius=graft_2, Decay=2, Bounds=rectangle.Rectangle)  # -> simplify(Field)
pcharge = PointCharge(Point=pop2d, Charge=graft, Decay=2, Bounds=rectangle.Rectangle)  # -> simplify(Field)
merge = Merge(Data1=pcharge, Data2=fspin)
mergef = MergeFields(Fields=merge)
pop2d_2 = Populate2D(Region=rectangle.Rectangle, Count=Slider(1000, range=0..1000), Seed=Slider(310, range=0..1000))
fline = FieldLine(Field=mergef, Point=pop2d_2, Steps=Slider(10, range=0..10), Accuracy=0.1, Method=3)  # -> simplify(Curve)
cp = ControlPoints(Curve=fline)  # -> simplify(Points), Weights, Knots
lng = ListLength(List=cp.Points)
range_3 = Range(Domain=Slider(10, range=0..10), Steps=number_slider_2)
pshift = ShiftPaths(Data=lng, Offset=-1)
Z = UnitZ(Factor=range_3)
reb = RebuildCurve(Curve=fline, Degree=Slider(3, range=0..10), Count=pshift, Tangents=False)
graft_3 = GraftTree(Tree=Z, IncludeEmptyLists=True, IncludeNullItems=True)
move = Move(Geometry=reb, Motion=graft_3)  # -> simplify(Geometry), Transform
flip = FlipMatrix(Data=move.Geometry)
loft = Loft(Curves=flip, Options={Adjust=False, Closed=False, LoftEnds=0, LoftSimp=0, LoftType=0, Rebuild=10, Refit=0.01})
mesh = Mesh(loft)
demesh = DeconstructMesh(Mesh=mesh)  # -> Vertices, Faces, Colours, Normals
pdecon = Deconstruct(Point=demesh.Vertices)  # -> XComponent, YComponent, ZComponent
bnd = Bounds(Numbers=flatten(pdecon.ZComponent))
remap = RemapNumbers(Value=pdecon.ZComponent, Source=bnd, Target=Domain(0, 1))  # -> Mapped, Clipped
pt = ConstructPoint(XCoordinate=pdecon.XComponent, YCoordinate=pdecon.YComponent, ZCoordinate=0)
gradient = Gradient(LowerLimit=0, UpperLimit=1, Parameter=remap.Mapped, stops=[0.114: RGB(0, 191, 255), 0.854: RGB(125, 220, 255)])
area = Area(Geometry=rectangle.Rectangle)  # -> Area, Centroid
dist = Distance(PointA=area.Centroid, PointB=pt)
bnd_2 = Bounds(Numbers=flatten(dist))
argb = SplitARGB(Colour=gradient)  # -> Alpha, Red, Green, Blue
remap_2 = RemapNumbers(Value=dist, Source=bnd_2, Target=Slider(0.64, range=0..1))  # -> Mapped, Clipped
subtraction = Subtraction(A=argb.Blue, B=remap_2.Mapped)
subtraction_2 = Subtraction(A=argb.Green, B=remap_2.Mapped)
subtraction_3 = Subtraction(A=argb.Red, B=remap_2.Mapped)
frgb = ColourRGBF(Alpha=1, Red=subtraction_3, Green=subtraction_2, Blue=subtraction)
mcol = MeshColours(Mesh=mesh, Colours=frgb)
