# Grasshopper definition 8-Drill Bit.gh (Grasshopper 1.0.7)
# plug-ins: Kangaroo Components, PlanktonGh

number_slider = Slider(50, range=0..100)
cir = Circle(Plane=PlaneXY(0, 0, 0), Radius=Slider(50, range=0..100))
Z = UnitZ(Factor=Slider(300, range=0..1000))
range = Range(Domain=Domain(0, 1), Steps=number_slider)
range_2 = Range(Domain=Slider(3, range=0..10), Steps=number_slider)
extr = Extrude(Base=cir, Direction=Z)
mod = Modulus(A=range_2, B="1")
srf = Surface(reparameterize(extr))
pt = ConstructPoint(XCoordinate=range, YCoordinate=mod, ZCoordinate=0)
evalsrf = EvaluateSurface(Surface=srf, Point=pt)  # -> Point, Normal, UDirection, VDirection, Frame
number_slider_2 = Slider(100, range=0..100)
intcrv = Interpolate(Vertices=evalsrf.Point, Degree=3, Periodic=False, KnotStyle=1)  # -> Curve, Length, Domain
number_slider_3 = Slider(1.2, range=0..2)
area = Area(Geometry=srf)  # -> Area, Centroid
ext = ExtendCurve(Curve=intcrv.Curve, Type=0, Start=number_slider_2, End=number_slider_2)
scale_nu = ScaleNU(Geometry=ext, Plane=area.Centroid, ScaleX=number_slider_3, ScaleY=number_slider_3, ScaleZ=1)  # -> Geometry, Transform
pipe = Pipe(Curve=scale_nu.Geometry, Radius=Slider(30, range=0..100), Caps=0)
cap = CapHoles(Brep=pipe)
sequence = Sequence(Frames="2")
mesh = Mesh(cap)
meshmachine = MeshMachine(
    Geometry=mesh,
    Length=Slider(10, range=0..10),
    Flip=1,
    PullStrength=0.8,
    CurvatureAdaptivity=0,
    BoundaryScale=1,
    BoundaryDistance=5,
    Exponent=2,
    Background=0.5,
    Iterations=Slider(3, range=0..10),
    Reset=sequence)
rev = ReverseList(List=meshmachine)
item = ListItem(List=rev, Index=0, Wrap=True)
pmesh = PlanktonMesh(item)
mesh_2 = Mesh(pmesh)
meshtonurb = MeshToNurb(m=mesh_2)  # -> out, a
# ---------- meshtonurb: Python ----------
import rhinoscriptsyntax as rs
a = rs.MeshToNurb(m)
# ---------- end meshtonurb ----------
cap_2 = CapHoles(Brep=extr)
sdiff = SolidDifference(BrepsA=cap_2, BrepsB=meshtonurb.a)
debrep = DeconstructBrep(Brep=sdiff)  # -> Faces, Edges, Vertices
area_2 = Area(Geometry=debrep.Faces)  # -> Area, Centroid
sort = SortList(Keys=area_2.Area, ValuesA=debrep.Faces)  # -> Keys, ValuesA
sort_2 = SortList(Keys=area_2.Area, ValuesA=area_2.Centroid)  # -> Keys, ValuesA
larger = LargerThan(FirstNumber=sort.Keys, SecondNumber=Slider(500, range=0..1000))  # -> LargerThan, OrEqualTo
dispatch = Dispatch(List=sort_2.ValuesA, DispatchPattern=larger.LargerThan)  # -> ListA, ListB
dispatch_2 = Dispatch(List=sort.ValuesA, DispatchPattern=larger.LargerThan)  # -> ListA, ListB
pdecon = Deconstruct(Point=dispatch.ListB)  # -> XComponent, YComponent, ZComponent
pdecon_2 = Deconstruct(Point=area.Centroid)  # -> XComponent, YComponent, ZComponent
preview = CustomPreview(Geometry=dispatch_2.ListA, Shader=ColourSwatch(SwatchColor=RGB(73, 149, 242)))
pt_2 = ConstructPoint(XCoordinate=pdecon.XComponent, YCoordinate=pdecon.YComponent, ZCoordinate=0)
pt_3 = ConstructPoint(XCoordinate=pdecon_2.XComponent, YCoordinate=pdecon_2.YComponent, ZCoordinate=0)
dist = Distance(PointA=pt_2, PointB=pt_3)
bnd = Bounds(Numbers=dist)
remap = RemapNumbers(Value=dist, Source=bnd, Target=Domain(0, 1))  # -> Mapped, Clipped
gradient = Gradient(LowerLimit=0, UpperLimit=1, Parameter=remap.Mapped, stops=[0.15: RGB(21, 56, 102), 0.85: RGB(68, 130, 252)])
preview_2 = CustomPreview(Geometry=dispatch_2.ListB, Shader=gradient)
